# Grasshopper definition Arch565_Assign02_Linking_Programs_Pierce_Jacob.gh (Grasshopper 1.0.8)
# plug-ins: Rhino.Inside for Autodesk Revit

box = Box({Plane=PlaneXY(0, 0, 0), X=Domain(0, 0.6354166667), Y=Domain(0, 0.3020833333), Z=Domain(0, 0.1875)})
move = Move(Geometry=box, Motion=Vector(0, 0, 10))  # -> Geometry, Transform
unit_z = UnitZ(Factor=Slider(0.25, range=0..1))
linear_array = LinearArray(Geometry=box, Direction=unit_z, Count=Slider(50, range=0..100))  # -> Geometry, Transform
unit_x = UnitX(Factor=Slider(0.67, range=0..1))
linear_array_2 = LinearArray(Geometry=linear_array.Geometry, Direction=unit_x, Count=Slider(70, range=0..1000))  # -> Geometry, Transform
area = Area(Geometry=linear_array_2.Geometry)  # -> Area, Centroid
curve = Curve(<curve referenced from the Rhino model>)
curve_closest_point = CurveClosestPoint(Point=area.Centroid, Curve=curve)  # -> Point, Parameter, Distance
distance = Distance(PointA=area.Centroid, PointB=curve_closest_point.Point)
unit_y = UnitY(Factor=distance)
move_2 = Move(Geometry=linear_array_2.Geometry, Motion=unit_y)  # -> Geometry, Transform
unit_x_2 = UnitX(Factor=Slider(-20, range=-20..100))
move_3 = Move(Geometry=move_2.Geometry, Motion=unit_x_2)  # -> Geometry, Transform
add_directshape_brep = AddDirectShapeBrep(Brep=move_3.Geometry, TrackingMode=2)
deconstruct_brep = DeconstructBrep(Brep=move_3.Geometry)  # -> Faces, Edges, Vertices
list_item = ListItem(List=deconstruct_brep.Faces, Index=Slider(8, range=0..10), Wrap=True)
brep_edges = BrepEdges(Brep=list_item)  # -> Naked, Interior, NonManifold
