# Grasshopper definition Perf_Metal_Rhino.gh (Grasshopper 1.0.8)
# plug-ins: Rhino.Inside for Autodesk Revit

graphical_element = GraphicalElement(<wall referenced from the Revit model>)
element_parts_geometry = ElementPartsGeometry(Element=graphical_element)
deconstruct_brep = DeconstructBrep(Brep=element_parts_geometry)  # -> Faces, Edges, Vertices
area = Area(Geometry=deconstruct_brep.Faces)  # -> Area, Centroid
list_item = ListItem(List=deconstruct_brep.Faces, Index=Slider(0, range=0..5), Wrap=True)
point_list = PointList(Points=area.Centroid, Size=Slider(1, range=0..10))
surface = Surface(list_item)
data_dam = DataDam(DataA=surface, BufferDelay=10000000, BufferMode=0)
surface_2 = Surface(data_dam)
divide_surface = DivideSurface(Surface=surface_2, UCount=Slider(100, range=0..500), VCount=Slider(100, range=0..300))  # -> Points, Normals, Parameters

panel = Panel("""-1
0""")
cull_index = CullIndex(List=divide_surface.Points, Indices=panel, Wrap=True)
flip_matrix = FlipMatrix(Data=cull_index)
cull_index_2 = CullIndex(List=flip_matrix, Indices=panel, Wrap=True)
cull_pattern = CullPattern(List=cull_index_2, CullPattern=[True, False])
cull_pattern_2 = CullPattern(List=cull_index_2, CullPattern=[False, True])
flip_matrix_2 = FlipMatrix(Data=cull_pattern)
flip_matrix_3 = FlipMatrix(Data=cull_pattern_2)
cull_pattern_3 = CullPattern(List=flip_matrix_2, CullPattern=[True, False])
cull_pattern_4 = CullPattern(List=flip_matrix_3, CullPattern=[False, True])
point = Point(flatten([cull_pattern_3, cull_pattern_4]))

area_2 = Area(Geometry=surface_2)  # -> Area, Centroid
evaluate_surface = EvaluateSurface(Surface=surface_2, Point=area_2.Centroid)  # -> Point, Normal, UDirection, VDirection, Frame

point_2 = Point(point)
curve = Curve([<curve referenced from the Rhino model> x15])
point_in_curves = PointInCurves(Point=point_2, Curves=curve)  # -> Relationship, Index, Point
cull_pattern_5 = CullPattern(List=point_2, CullPattern=point_in_curves.Relationship)
curve_2 = Curve([<curve referenced from the Rhino model> x3])
point_in_curves_2 = PointInCurves(Point=cull_pattern_5, Curves=curve_2)  # -> Relationship, Index, Point
cull_pattern_6 = CullPattern(List=point_2, CullPattern=invert(point_in_curves.Relationship))
cull_pattern_7 = CullPattern(List=cull_pattern_5, CullPattern=point_in_curves_2.Relationship)
cull_pattern_8 = CullPattern(List=cull_pattern_5, CullPattern=invert(point_in_curves_2.Relationship))
point_3 = Point(flatten([cull_pattern_6, cull_pattern_7]))
point_4 = Point(flatten(cull_pattern_8))

data_dam_2 = DataDam(DataDataA=point_4, BufferDelay=10000000, BufferMode=0)
data_dam_3 = DataDam(DataDataA=point_3, BufferDelay=10000000, BufferMode=0)
deconstruct = Deconstruct(Point=data_dam_2)  # -> XComponent, YComponent, ZComponent
yz_plane = YZPlane(Origin=point_4)
yz_plane_2 = YZPlane(Origin=point_3)
xz_plane = XZPlane(Origin=point_3)
bounds = Bounds(Numbers=deconstruct.YComponent)

deconstruct_2 = Deconstruct(Point=data_dam_3)  # -> XComponent, YComponent, ZComponent
bounds_2 = Bounds(Numbers=deconstruct_2.XComponent)
remap_numbers = RemapNumbers(Value=deconstruct_2.XComponent, Source=bounds_2, Target=Domain(0, 1))  # -> Mapped, Clipped
graph_mapper = GraphMapper(
    remap_numbers.Mapped,
    x0=0,
    x1=1,
    y0=0,
    y1=1,
    A=0.3026123047,
    B=0.3024114966,
    container_name="Linear",
    Graph_x0=0,
    Graph_x1=1,
    Graph_y0=0.3024114966,
    Graph_y1=0.6050238013)
multiplication = Multiplication(A=graph_mapper, B=Slider(0.2, range=0..1))

remap_numbers_2 = RemapNumbers(Value=deconstruct.YComponent, Source=bounds, Target=Domain(0, 1))  # -> Mapped, Clipped
graph_mapper_2 = GraphMapper(
    remap_numbers_2.Mapped,
    x0=0,
    x1=1,
    y0=0,
    y1=1,
    A=0.2864450812,
    B=0.2003425956,
    container_name="Linear",
    Graph_x0=0,
    Graph_x1=1,
    Graph_y0=0.2003425956,
    Graph_y1=0.4867876768)
multiplication_2 = Multiplication(A=graph_mapper_2, B=Slider(0.18, range=0..1))
polygon = Polygon(Plane=yz_plane, Radius=multiplication_2, Segments=6, FilletRadius=0)  # -> Polygon, Length
polygon_2 = Polygon(Plane=xz_plane, Radius=multiplication, Segments=6, FilletRadius=0)  # -> Polygon, Length
geometry = Geometry([polygon_2.Polygon, surface_2, polygon.Polygon])
data_dam_4 = DataDam(DataDataA=geometry, BufferDelay=10000000, BufferMode=0)
category = Category(<category referenced from the Revit model>)
boundary_surfaces = BoundarySurfaces(Edges=data_dam_4)
query_types = QueryTypes(Kind=3, Category=category)
data_dam_5 = DataDam(DataDataA=boundary_surfaces, BufferDelay=10000000, BufferMode=0)
value_picker = ValuePicker(query_types)
surface_3 = Surface(data_dam_5)
add_wall_profile = AddWallProfile(Profile=surface_3, Type=value_picker, TrackingMode=2)
