# Grasshopper definition revittoposolidworking.gh (Grasshopper 1.0.8)
# plug-ins: Rhino.Inside for Autodesk Revit

curve = Curve(flatten([<curve referenced from the Rhino model> x12]))
divide_curve = DivideCurve(Curve=curve, Count=Slider(50, range=0..100), Kinks=False)  # -> Points, Tangents, Parameters
curve_2 = Curve(<curve referenced from the Rhino model>)
flatten_tree = FlattenTree(Tree=divide_curve.Points, Path="{0}")
add_toposolid = AddToposolid(Boundary=curve_2, Points=flatten_tree, TrackingMode=2)
