# Grasshopper definition Perf_Metal_Rhino.gh (Grasshopper 1.0.8)
# plug-ins: Rhino.Inside for Autodesk Revit

graphical_element = GraphicalElement(<genericform referenced from the Revit model>)
element_geometry = ElementGeometry(Elements=graphical_element)
deconstruct_brep = DeconstructBrep(Brep=element_geometry)  # -> Faces, Edges, Vertices
area = Area(Geometry=deconstruct_brep.Faces)  # -> Area, Centroid
list_item = ListItem(List=deconstruct_brep.Faces, Index=Slider(2, range=0..5), Wrap=True)
point_list = PointList(Points=area.Centroid, Size=Slider(1, range=0..10))
surface = Surface(list_item)
unit_y = UnitY(Factor=1)
unit_x = UnitX(Factor=1)
data_dam = DataDam(DataDataA=surface, BufferDelay=10000000, BufferMode=0)
unit_z = UnitZ(Factor=1)
mesh = Mesh()
surface_2 = Surface(data_dam)
edges_from_directions = EdgesFromDirections(Brep=surface_2, Directions=unit_z, Reflex=True, Angle=0)  # -> Edges, Indices, Map
edges_from_directions_2 = EdgesFromDirections(Brep=surface_2, Directions=unit_x, Reflex=True, Angle=0)  # -> Edges, Indices, Map
md_slider = MDSlider(SliderMode=0, slider_value=Point(0, 0, 0.5), x_domain=Domain(0, 1), y_domain=Domain(0, 1), z_domain=Domain(0, 1))
number_slider = Slider(0.25, range=0.01..1)
length = Length(Curve=edges_from_directions.Edges)
length_2 = Length(Curve=edges_from_directions_2.Edges)
division = Division(A=length, B=number_slider)
division_2 = Division(A=length_2, B=number_slider)
evaluate_surface = EvaluateSurface(Surface=surface_2, Point=md_slider)  # -> Point, Normal, UDirection, VDirection, Frame
panel = Panel(division_2)
divide_surface = DivideSurface(Surface=surface_2, UCount=Slider(22, range=1..200), VCount=Slider(32, range=1..200))  # -> Points, Normals, Parameters

panel_2 = Panel("""-1
0""")
cull_index = CullIndex(List=divide_surface.Points, Indices=panel_2, Wrap=True)
flip_matrix = FlipMatrix(Data=cull_index)
cull_index_2 = CullIndex(List=flip_matrix, Indices=panel_2, Wrap=True)
cull_pattern = CullPattern(List=cull_index_2, CullPattern=[True, False])
cull_pattern_2 = CullPattern(List=cull_index_2, CullPattern=[False, True])
flip_matrix_2 = FlipMatrix(Data=cull_pattern)
flip_matrix_3 = FlipMatrix(Data=cull_pattern_2)
cull_pattern_3 = CullPattern(List=flip_matrix_2, CullPattern=[True, False])
cull_pattern_4 = CullPattern(List=flip_matrix_3, CullPattern=[False, True])
point = Point(flatten([cull_pattern_3, cull_pattern_4]))

panel_3 = Panel(division)
plane = Plane(evaluate_surface.Frame)
mesh_surface = MeshSurface(Surface=surface_2, UCount=5, VCount=5, Overhang=True, Equalize=False)

point_2 = Point(point)
curve = Curve([<curve referenced from the Rhino model> x2])
point_in_curves = PointInCurves(Point=point_2, Curves=curve)  # -> Relationship, Index, Point
cull_pattern_5 = CullPattern(List=point_2, CullPattern=point_in_curves.Relationship)
curve_2 = Curve(<curve referenced from the Rhino model>)
point_in_curves_2 = PointInCurves(Point=cull_pattern_5, Curves=curve_2)  # -> Relationship, Index, Point
cull_pattern_6 = CullPattern(List=point_2, CullPattern=invert(point_in_curves.Relationship))
cull_pattern_7 = CullPattern(List=cull_pattern_5, CullPattern=point_in_curves_2.Relationship)
cull_pattern_8 = CullPattern(List=cull_pattern_5, CullPattern=invert(point_in_curves_2.Relationship))
point_3 = Point(flatten([cull_pattern_6, cull_pattern_7]))
point_4 = Point(flatten(cull_pattern_8))

data_dam_2 = DataDam(DataDataA=point_4, BufferDelay=10000000, BufferMode=0)
data_dam_3 = DataDam(DataDataA=point_3, BufferDelay=10000000, BufferMode=0)
deconstruct = Deconstruct(Point=data_dam_2)  # -> XComponent, YComponent, ZComponent
yz_plane = YZPlane(Origin=point_3)
xz_plane = XZPlane(Origin=point_3)
bounds = Bounds(Numbers=deconstruct.XComponent)

deconstruct_2 = Deconstruct(Point=data_dam_3)  # -> XComponent, YComponent, ZComponent
bounds_2 = Bounds(Numbers=deconstruct_2.XComponent)
remap_numbers = RemapNumbers(Value=deconstruct_2.XComponent, Source=bounds_2, Target=Domain(0, 1))  # -> Mapped, Clipped
graph_mapper = GraphMapper(
    remap_numbers.Mapped,
    x0=0,
    x1=1,
    y0=0,
    y1=1,
    A=-0.2638235688,
    B=0.8829411864,
    container_name="Linear",
    Graph_x0=0,
    Graph_x1=1,
    Graph_y0=0.8829411864,
    Graph_y1=0.6191176176)
multiplication = Multiplication(A=graph_mapper, B=Slider(0.18, range=0..1))

remap_numbers_2 = RemapNumbers(Value=deconstruct.XComponent, Source=bounds, Target=Domain(0, 1))  # -> Mapped, Clipped
xz_plane_2 = XZPlane(Origin=point_4)
yz_plane_2 = YZPlane(Origin=point_4)
plane_2 = Plane(plane)
plane_3 = Plane(plane)
graph_mapper_2 = GraphMapper(
    remap_numbers_2.Mapped,
    x0=0,
    x1=1,
    y0=0,
    y1=1,
    A=-0.3450171351,
    B=0.6480664015,
    container_name="Linear",
    Graph_x0=0,
    Graph_x1=1,
    Graph_y0=0.6480664015,
    Graph_y1=0.3030492663)
multiplication_2 = Multiplication(A=graph_mapper_2, B=Slider(0.18, range=0..1))
polygon = Polygon(Plane=xz_plane_2, Radius=multiplication_2, Segments=6, FilletRadius=0)  # -> Polygon, Length
polygon_2 = Polygon(Plane=xz_plane, Radius=multiplication, Segments=6, FilletRadius=0)  # -> Polygon, Length
edges_from_faces = EdgesFromFaces(Brep=surface_2, Points=divide_surface.Points)  # -> Edges, Indices
geometry = Geometry([polygon_2.Polygon, polygon.Polygon, surface_2])
data_dam_4 = DataDam(DataDataA=geometry, BufferDelay=10000000, BufferMode=0)
yz_plane_3 = YZPlane(Origin=Point(0, 0, 0))
curve_3 = Curve([<curve referenced from the Rhino model> x5000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])
boundary_surfaces = BoundarySurfaces(Edges=data_dam_4)
curve_4 = Curve(<curve referenced from the Rhino model>)
view = View(<floorplan referenced from the Revit model>)
xy_plane = XYPlane(Origin=Point(0, 0, 0))
add_analytical_panel_extrusion = AddAnalyticalPanelExtrusion(TrackingMode=2)
add_directshape_curve = AddDirectShapeCurve(Curve=[curve_3, curve_4], TrackingMode=2)
panel_4 = Panel("90")
explode = Explode(Curve=curve_3, Recursive=True)  # -> Segments, Vertices
add_detail_line = AddDetailLine(View=view, Curve=curve_4, TrackingMode=2)
