# Grasshopper definition 03 - Heron - ClassDemo.gh (Grasshopper 1.0.7)
# plug-ins: Heron, Bifocals

# ----
# Get Parcels
panel = Panel("E:\Parcels\Parcels.shp")
curve = Curve(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)
import_vector = ImportVector(Boundary=curve, FilePath=panel, ClipIt=True, PointsOnly=False)  # -> DataExtents, Fields, Values, FeatureGeometry
panel_2 = Panel(import_vector.FeatureGeometry)
mesh_edges = MeshEdges(Mesh=import_vector.FeatureGeometry)  # -> NakedEdges, InteriorEdges, NonManifoldEdges
curve_2 = Curve(mesh_edges.NakedEdges)

set_earthanchorpoint = SetEarthAnchorPoint(SetEAP=Toggle(True), Latitude="45.6632217", Longitude="-111.0535119")
panel_3 = Panel(set_earthanchorpoint)
c_script = CSharpScript()  # -> Out, A
