# Grasshopper definition AttaractorCurve.gh (Grasshopper 1.0.7)
# plug-ins: Bifocals

curve = Curve(<curve referenced from the Rhino model>)
brep = Brep(<brep referenced from the Rhino model>)
divide_domain² = DivideDomain²(Domain=brep, UCount=Slider(91, range=0..100), VCount=Slider(25, range=0..100))
isotrim = Isotrim(Surface=brep, Domain=divide_domain²)
polygon_center = PolygonCenter(Polyline=isotrim)  # -> CenterV, CenterE, CenterA
curve_closest_point = CurveClosestPoint(Point=polygon_center.CenterV, Curve=curve)  # -> Point, Parameter, Distance
number_slider = Slider(4.35, range=0..10)
bounds = Bounds(Numbers=curve_closest_point.Distance)
construct_domain = ConstructDomain(DomainStart=Slider(7.799, range=0..10), DomainEnd=Slider(1.25, range=0..10))
remap_numbers = RemapNumbers(Value=curve_closest_point.Distance, Source=bounds, Target=construct_domain)  # -> Mapped, Clipped
subtraction = Subtraction(A=Slider(2.08, range=0..10), B=remap_numbers.Mapped)
xy_plane = XYPlane(Origin=polygon_center.CenterV)
bounds_2 = Bounds(Numbers=subtraction)
unit_z = UnitZ(Factor=1)
panel = Panel(bounds_2)
polygon = Polygon(Plane=xy_plane, Radius=subtraction, Segments=Slider(6, range=0..10), FilletRadius=0)  # -> Polygon, Length
circle_cnr = CircleCNR(Center=polygon_center.CenterV, Normal=unit_z, Radius=subtraction)
