# Grasshopper definition Grasshopper - Data Trees - Spaceframe.gh (Grasshopper 1.0.8)
# plug-ins: Bifocals

# ----
# Shift Lists / Circles
number_slider = Slider(194, range=0..1000)  # disabled
number_slider_2 = Slider(70, range=0..100)  # disabled
number_slider_3 = Slider(100, range=0..100)  # disabled
construct_point = ConstructPoint(XCoordinate=0, YCoordinate=0, ZCoordinate=number_slider)  # disabled
construct_point_2 = ConstructPoint(XCoordinate=0, YCoordinate=0, ZCoordinate=0)  # disabled
circle_cnr = CircleCNR(Center=construct_point, Normal=Vector(0, 0, 1), Radius=number_slider_2)  # disabled
circle_cnr_2 = CircleCNR(Center=construct_point_2, Normal=Vector(0, 0, 1), Radius=number_slider_3)  # disabled
number_slider_4 = Slider(17, range=0..100)  # disabled
divide_curve = DivideCurve(Curve=circle_cnr, Count=number_slider_4, Kinks=False)  # -> Points, Tangents, Parameters; disabled
divide_curve_2 = DivideCurve(Curve=circle_cnr_2, Count=number_slider_4, Kinks=False)  # -> Points, Tangents, Parameters; disabled
number_slider_5 = Slider(1, range=0..100)  # disabled
boolean_toggle = BooleanToggle(True)  # disabled
shift_list = ShiftList(List=divide_curve.Points, Shift=number_slider_5, Wrap=boolean_toggle)  # disabled
line = Line(StartPoint=shift_list, EndPoint=divide_curve_2.Points)  # disabled
line_2 = Line(StartPoint=divide_curve.Points, EndPoint=divide_curve_2.Points)  # disabled

# ----
# Data List / Surface Connections
number_slider_6 = Slider(12, range=0..100)  # disabled
number_slider_7 = Slider(12, range=0..100)  # disabled
surface = Surface(<surface referenced from the Rhino model>)  # disabled
divide_domain² = DivideDomain²(Domain=surface, UCount=number_slider_6, VCount=number_slider_7)  # disabled
isotrim = Isotrim(Surface=surface, Domain=divide_domain²)  # disabled
deconstruct_brep = DeconstructBrep(Brep=isotrim)  # -> Faces, Edges, Vertices; disabled
panel = Panel("0")  # disabled
list_item = ListItem(List=deconstruct_brep.Vertices, Index=panel, Wrap=True)  # -> Item, Item1, Item2, Item3; disabled
panel_2 = Panel("""true
false""")  # disabled
dispatch = Dispatch(List=flatten(deconstruct_brep.Faces), DispatchPattern=panel_2)  # -> ListA, ListB; disabled
line_3 = Line(StartPoint=list_item.Item1, EndPoint=list_item.Item3)  # disabled
line_4 = Line(StartPoint=list_item.Item, EndPoint=list_item.Item2)  # disabled
surface_2 = Surface(dispatch.ListA)  # disabled
surface_3 = Surface(dispatch.ListB)  # disabled
deconstruct_brep_2 = DeconstructBrep(Brep=surface_2)  # -> Faces, Edges, Vertices; disabled
deconstruct_brep_3 = DeconstructBrep(Brep=surface_3)  # -> Faces, Edges, Vertices; disabled
panel_3 = Panel("0")  # disabled
panel_4 = Panel("0")  # disabled
list_item_2 = ListItem(List=deconstruct_brep_2.Vertices, Index=panel_3, Wrap=True)  # -> Item, Item1, Item2, Item3; disabled
list_item_3 = ListItem(List=deconstruct_brep_3.Vertices, Index=panel_4, Wrap=True)  # -> Item, Item1, Item2, Item3; disabled
line_5 = Line(StartPoint=list_item_2.Item1, EndPoint=list_item_2.Item3)  # disabled
line_6 = Line(StartPoint=list_item_3.Item, EndPoint=list_item_3.Item2)  # disabled

# ----
# Data Lists / Grid List
series = Series(Start=0, Step=1, Count=10)  # disabled
series_2 = Series(Start=0, Step=1, Count=10)  # disabled
number_slider_8 = Slider(0.7, range=0..1)  # disabled
construct_point_3 = ConstructPoint(XCoordinate=graft(series), YCoordinate=series_2, ZCoordinate=0)  # disabled
number_slider_9 = Slider(4, range=0..10)  # disabled
panel_5 = Panel(construct_point_3)  # disabled
panel_6 = Panel("10")  # disabled
polygon = Polygon(Plane=construct_point_3, Radius=number_slider_8, Segments=number_slider_9, FilletRadius=0)  # -> Polygon, Length; disabled
random = Random(Range=Domain(0, 1), Number=panel_6, Seed=2)  # disabled
param_viewer = ParamViewer(polygon.Polygon)  # disabled
rotate = Rotate(Geometry=polygon.Polygon, Angle=random, Plane=construct_point_3)  # -> Geometry, Transform; disabled
panel_7 = Panel(polygon.Polygon)  # disabled

# ----
# Divide Surface
number_slider_10 = Slider(11, range=0..100)
number_slider_11 = Slider(12, range=0..100)
# Data Set / Space Frame Logic
# Reset to a new surface
surface_4 = Surface(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)
divide_domain²_2 = DivideDomain²(Domain=surface_4, UCount=number_slider_10, VCount=number_slider_11)
isotrim_2 = Isotrim(Surface=surface_4, Domain=divide_domain²_2)

# ----
# Panel Fabrication
# Trangle Panels
surface_5 = Surface(isotrim_2)
deconstruct_brep_4 = DeconstructBrep(Brep=surface_5)  # -> Faces, Edges, Vertices
list_item_4 = ListItem(List=deconstruct_brep_4.Vertices, Index="0", Wrap=True)  # -> Item, Item1, Item2, Item3
_4point_surface = _4PointSurface(CornerA=list_item_4.Item, CornerB=list_item_4.Item1, CornerC=list_item_4.Item2)
_4point_surface_2 = _4PointSurface(CornerA=list_item_4.Item, CornerB=list_item_4.Item2, CornerC=list_item_4.Item3)

# ----
# Create Chords and Webs
panel_8 = Panel("0.5")
construct_point_4 = ConstructPoint(XCoordinate=panel_8, YCoordinate=panel_8, ZCoordinate=0)
deconstruct_brep_5 = DeconstructBrep(Brep=isotrim_2)  # -> Faces, Edges, Vertices
evaluate_surface = EvaluateSurface(Surface=reparameterize(isotrim_2), Point=construct_point_4)  # -> Point, Normal, UDirection, VDirection, Frame
amplitude = Amplitude(Vector=evaluate_surface.Normal, Amplitude=Slider(-59, range=-100..100))
list_item_5 = ListItem(List=deconstruct_brep_5.Vertices, Index="0", Wrap=True)  # -> Item, Item1, Item2, Item3
move = Move(Geometry=evaluate_surface.Point, Motion=amplitude)  # -> Geometry, Transform
line_7 = Line(StartPoint=[list_item_5.Item, list_item_5.Item1, list_item_5.Item2, list_item_5.Item3], EndPoint=graft(move.Geometry))

# ----
# Create Bottom Chords
point = Point(move.Geometry)
number = Number(number_slider_11)
partition_list = PartitionList(List=point, Size=number)
flip_matrix = FlipMatrix(Data=partition_list)
polyline = PolyLine(Vertices=flip_matrix, Closed=False)
polyline_2 = PolyLine(Vertices=partition_list, Closed=False)

surface_6 = Surface([_4point_surface, _4point_surface_2])
custom_preview = CustomPreview(Geometry=surface_6, Material=ColourSwatch(SwatchColor=RGBA(255, 255, 255, 152)))

# ---- group: Location
point_2 = Point(Point(14.19818585, -395.0048833, 0))

# ----
# Orient Panles to Cut List
spacing = Slider(177, range=0..1000)
surface_7 = Surface(_4point_surface)
construct_point_5 = ConstructPoint(XCoordinate=0, YCoordinate=0, ZCoordinate=0)
unit_x = UnitX(Factor=spacing)
list_length = ListLength(List=flatten(surface_7))
xy_plane = XYPlane(Origin=point_2)
evaluate_surface_2 = EvaluateSurface(Surface=reparameterize(surface_7), Point=construct_point_5)  # -> Point, Normal, UDirection, VDirection, Frame
linear_array = LinearArray(Geometry=xy_plane, Direction=unit_x, Count=list_length)  # -> graft(Geometry), Transform
orient = Orient(Geometry=surface_7, Source=evaluate_surface_2.Frame, Target=linear_array.Geometry)  # -> Geometry, Transform

# ---- group: Location
point_3 = Point(Point(14.19818585, -528.2346554, 0))

# ----
# Orient Panles to Cut List
spacing_2 = Slider(177, range=0..1000)
surface_8 = Surface(_4point_surface_2)
construct_point_6 = ConstructPoint(XCoordinate=0, YCoordinate=0, ZCoordinate=0)
unit_x_2 = UnitX(Factor=spacing_2)
list_length_2 = ListLength(List=flatten(surface_8))
xy_plane_2 = XYPlane(Origin=point_3)
evaluate_surface_3 = EvaluateSurface(Surface=reparameterize(surface_8), Point=construct_point_6)  # -> Point, Normal, UDirection, VDirection, Frame
linear_array_2 = LinearArray(Geometry=xy_plane_2, Direction=unit_x_2, Count=list_length_2)  # -> graft(Geometry), Transform
orient_2 = Orient(Geometry=surface_8, Source=evaluate_surface_3.Frame, Target=linear_array_2.Geometry)  # -> Geometry, Transform

# ----
# Top Chords
curve = Curve(deconstruct_brep_5.Edges)

# ----
# Webs
curve_2 = Curve(line_7)

# ----
# Bottom Chords
curve_3 = Curve([polyline, polyline_2])

# ----
# Text Tag Cut List Panels
number_slider_12 = Slider(-33, range=-100..100)
plane = Plane(linear_array.Geometry)
unit_y = UnitY(Factor=number_slider_12)
move_2 = Move(Geometry=plane, Motion=unit_y)  # -> Geometry, Transform
list_length_3 = ListLength(List=flatten(move_2.Geometry))
series_3 = Series(Start=0, Step=1, Count=list_length_3)  # -> graft(Series)
concatenate = Concatenate(FragmentA="Panel A-", FragmentB=series_3)
text_tag_3d = TextTag3D(Location=move_2.Geometry, Text=concatenate, Size=Slider(12, range=0..100), Justification=7)

# ----
# Dimesion Cut List Panels
surface_9 = Surface(orient.Geometry)
deconstruct_brep_6 = DeconstructBrep(Brep=surface_9)  # -> Faces, Edges, Vertices
offset_curve = OffsetCurve(Curve=deconstruct_brep_6.Edges, Distance=Slider(10, range=0..10), Corners=1)
line_dimension = LineDimension(Line=offset_curve, Text="{0:0.00}", Size=Slider(4, range=0..10))

# ----
# Text Tag Cut List Panels
number_slider_13 = Slider(-33, range=-100..100)
plane_2 = Plane(linear_array_2.Geometry)
unit_y_2 = UnitY(Factor=number_slider_13)
move_3 = Move(Geometry=plane_2, Motion=unit_y_2)  # -> Geometry, Transform
list_length_4 = ListLength(List=flatten(move_3.Geometry))
series_4 = Series(Start=0, Step=1, Count=list_length_4)  # -> graft(Series)
concatenate_2 = Concatenate(FragmentA="Panel B-", FragmentB=series_4)
text_tag_3d_2 = TextTag3D(Location=move_3.Geometry, Text=concatenate_2, Size=Slider(12, range=0..100), Justification=7)

# ----
# Dimesion Cut List Panels
surface_10 = Surface(orient_2.Geometry)
deconstruct_brep_7 = DeconstructBrep(Brep=surface_10)  # -> Faces, Edges, Vertices
offset_curve_2 = OffsetCurve(Curve=deconstruct_brep_7.Edges, Distance=Slider(10, range=0..10), Corners=1)
line_dimension_2 = LineDimension(Line=offset_curve_2, Text="{0:0.00}", Size=Slider(4, range=0..10))

# ----
# Text Tag Model Panels
plane_3 = Plane(evaluate_surface_2.Frame)
list_length_5 = ListLength(List=flatten(plane_3))
series_5 = Series(Start=0, Step=1, Count=list_length_5)  # -> graft(Series)
concatenate_3 = Concatenate(FragmentA="Panel A-", FragmentB=series_5)
text_tag_3d_3 = TextTag3D(Location=plane_3, Text=concatenate_3, Size=Slider(4, range=0..100), Justification=7)

# ----
# Text Tag Model Panels
plane_4 = Plane(evaluate_surface_3.Frame)
list_length_6 = ListLength(List=flatten(plane_4))
series_6 = Series(Start=0, Step=1, Count=list_length_6)  # -> graft(Series)
concatenate_4 = Concatenate(FragmentA="Panel B-", FragmentB=series_6)
text_tag_3d_4 = TextTag3D(Location=plane_4, Text=concatenate_4, Size=Slider(4, range=0..100), Justification=7)

pipe = Pipe(Curve=[curve_2, curve, curve_3], Radius=1, Caps=0)
custom_preview_2 = CustomPreview(Geometry=pipe, Material=ColourSwatch(SwatchColor=RGB(69, 69, 69)))
