# Grasshopper definition Grasshopper - Data Trees - Tower.gh (Grasshopper 1.0.8)
# plug-ins: Bifocals

# ----
# Data Tree Tower
number_slider = Slider(12, range=0..100)
number_slider_2 = Slider(11, range=0..100)
series = Series(Start=0, Step=number_slider, Count=number_slider_2)
construct_point = ConstructPoint(XCoordinate=0, YCoordinate=0, ZCoordinate=series)
xy_plane = XYPlane(Origin=construct_point)
polygon = Polygon(Plane=xy_plane, Radius=Slider(16, range=0..100), Segments=Slider(3, range=3..12), FilletRadius=0)  # -> Polygon, Length

# ----
# Rotation
range = Range(Domain=Domain(0, 1), Steps=number_slider_2)
pi = Pi(Factor=Slider(0.5, range=0..2))
construct_domain = ConstructDomain(DomainStart="0", DomainEnd=pi)

graph_mapper = GraphMapper(range, x0=0, x1=1, y0=0, y1=1, container_name="Bezier", cpx=[0, 0.2237947136, 0.3160287738, 1], cpy=[0, 0, 1, 1])

remap_numbers = RemapNumbers(Value=graph_mapper, Source=Domain(0, 1), Target=construct_domain)  # -> Mapped, Clipped

rotate = Rotate(Geometry=polygon.Polygon, Angle=remap_numbers.Mapped, Plane=PlaneXY(0, 0, 0))  # -> Geometry, Transform

# ----
# Floor Plates
curve = Curve(rotate.Geometry)
negative = Negative(Value=Slider(2, range=0..2))
unit_z = UnitZ(Factor=negative)
boundary_surfaces = BoundarySurfaces(Edges=curve)
extrude = Extrude(Base=boundary_surfaces, Direction=unit_z)

# ----
# Corner Columns
curve_2 = Curve(rotate.Geometry)
explode = Explode(Curve=curve_2, Recursive=True)  # -> Segments, simplify(Vertices)
flip_matrix = FlipMatrix(Data=explode.Vertices)
polyline = PolyLine(Vertices=flip_matrix, Closed=False)
curve_3 = Curve(polyline)

geometry = Geometry(explode.Vertices)
param_viewer = ParamViewer(geometry)
panel = Panel(geometry)
param_viewer_2 = ParamViewer(geometry)
point_list = PointList(Points=geometry, Size=Slider(4, range=0..10))

# ----
# Purlins
curve_4 = Curve(rotate.Geometry)
explode_2 = Explode(Curve=curve_4, Recursive=True)  # -> Segments, simplify(Vertices)
divide_curve = DivideCurve(Curve=explode_2.Segments, Count=Slider(12, range=0..100), Kinks=False)  # -> Points, Tangents, Parameters
simplify_tree = SimplifyTree(Tree=divide_curve.Points, Front=False)
simplify_tree_2 = SimplifyTree(Tree=divide_curve.Points, Front=False)
path_mapper = PathMapper(simplify_tree, source="{A;B}(i)", target="{i;B}(A)")
path_mapper_2 = PathMapper(simplify_tree_2, source="{A;B}(i)", target="{A;i}(B)")
flip_matrix_2 = FlipMatrix(Data=divide_curve.Points)
polyline_2 = PolyLine(Vertices=path_mapper, Closed=False)
polyline_3 = PolyLine(Vertices=path_mapper_2, Closed=False)
curve_5 = Curve(polyline_2)
curve_6 = Curve(polyline_3)

geometry_2 = Geometry(flip_matrix)
param_viewer_3 = ParamViewer(geometry_2)
panel_2 = Panel(geometry_2)
param_viewer_4 = ParamViewer(geometry_2)
point_list_2 = PointList(Points=geometry_2, Size=Slider(4, range=0..10))
