# Grasshopper definition Grasshopper - Environment - Ladybug demo.gh (Grasshopper 1.0.8)
# plug-ins: Bifocals

panel = Panel("https://climate.onebuilding.org/WMO_Region_4_North_and_Central_America/USA_United_States_of_America/MT_Montana/USA_MT_Bozeman.Yellowstone.Intl.AP.726797_TMY3.zip")
downloadepw = LBDownloadWeather(weather_URL=panel)  # -> epw_file, stat_file, ddy_file; plug-in component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

button = Button()
panel_2 = Panel(button)
epwmap = LBEPWmap(epw_map=button)  # -> Output; plug-in component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

importepw = LBImportEPW(epw_file=downloadepw.epw_file)  # -> location, dry_bulb_temperature, dew_point_temperature, relative_humidity, wind_speed, wind_direction, direct_normal_rad, diffuse_horizontal_rad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; plug-in component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
hoy = LBCalculateHOY(month=Slider(1, range=1..12), day=Slider(1, range=1..31), hour=Slider(10, range=0..23))  # -> flatten(hoy), flatten(doy), flatten(date); plug-in component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

# ----
# Visualize Data
number_slider = Slider(2.4, range=0..10)
point = Point(Point(2159.588776, 49.60188557, 0))
point_2 = Point(Point(2167.914294, 614.0602242, 0))
point_3 = Point(Point(2151.263259, 1189.915245, 0))
point_4 = Point(Point(2163.751535, 1741.981384, 0))
psychrometricchart = LBPsychrometricChart(
    temperature=importepw.dry_bulb_temperature,
    rel_humidity=importepw.relative_humidity,
    pressure=importepw.barometric_pressure,
    base_pt=point_4,
    scale=number_slider)  # -> out, title, temp_lines, rh_lines, hr_lines, enth_wb_lines, mesh, legend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; plug-in component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
hourlyplot = LBHourlyPlot(data=importepw.dry_bulb_temperature, base_pt=point)  # -> out, mesh, legend, borders, labels, title, vis_set; plug-in component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
hourlyplot_2 = LBHourlyPlot(data=importepw.relative_humidity, base_pt=point_2)  # -> out, mesh, legend, borders, labels, title, vis_set; plug-in component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
hourlyplot_3 = LBHourlyPlot(data=importepw.barometric_pressure, base_pt=point_3)  # -> out, mesh, legend, borders, labels, title, vis_set; plug-in component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

# ----
# Sunlight Shade Study
number_slider_2 = Slider(21, range=0..23)
series = Series(Start=Slider(3, range=0..23), Step=1, Count=number_slider_2)
series_2 = Series(Start=Slider(1, range=1..12), Step=1, Count=Slider(12, range=1..12))
hoy_2 = LBCalculateHOY(month=graft(series_2), day=Slider(1, range=1..31), hour=series)  # -> flatten(hoy), flatten(doy), flatten(date); plug-in component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
sunpath = LBSunPath(location=importepw.location, hoys=hoy_2.hoy, scale=1)  # -> out, vectors, altitudes, azimuths, hoys, sun_pts, analemma, daily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; plug-in component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
colrange = LBColorRange(index=Slider(22, range=0..29))  # -> colors; plug-in component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
legendpar = LBLegendParameters(colors=colrange)  # -> leg_par; plug-in component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
geometry = Geometry(<surface referenced from the Rhino model>)
geometry_2 = Geometry([<extrusion referenced from the Rhino model> x6])
directsunhours = LBDirectSunHours(
    vectors=flatten(sunpath.vectors),
    geometry=flatten(geometry),
    context=flatten(geometry_2),
    grid_size=Slider(5, range=1..10),
    legend_par=legendpar,
    run=Toggle(True))  # -> out, points, results, mesh, legend, title, int_mtx; plug-in component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

point_5 = Point(Point(394.262246, -239.863192, 0))
xy_plane = XYPlane(Origin=point_5)

# ----
# Radiation
number_slider_3 = Slider(21, range=0..23)
series_3 = Series(Start=Slider(3, range=0..23), Step=1, Count=number_slider_3)
series_4 = Series(Start=Slider(1, range=1..12), Step=1, Count=Slider(12, range=1..12))
hoy_3 = LBCalculateHOY(month=graft(series_4), day=Slider(1, range=1..31), hour=series_3)  # -> flatten(hoy), flatten(doy), flatten(date); plug-in component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
colrange_2 = LBColorRange(index=Slider(3, range=0..29))  # -> colors; plug-in component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
skymatrix = LBCumulativeSkyMatrix(
    location=importepw.location,
    direct_rad=importepw.direct_normal_rad,
    diffuse_rad=importepw.diffuse_horizontal_rad,
    hoys=hoy_3.hoy)  # -> out, sky_mtx; plug-in component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
legendpar_2 = LBLegendParameters(colors=colrange_2, base_plane=xy_plane)  # -> leg_par; plug-in component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
geometry_3 = Geometry(<surface referenced from the Rhino model>)
geometry_4 = Geometry([<extrusion referenced from the Rhino model> x6])
incidentradiation = LBIncidentRadiation(
    sky_mtx=skymatrix.sky_mtx,
    geometry=flatten(geometry_4),
    context=flatten(geometry_4),
    grid_size=Slider(2, range=1..10),
    legend_par=legendpar_2,
    run=Toggle(True))  # -> out, points, results, total, mesh, legend, title, int_mtx; plug-in component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
