# Grasshopper definition Grasshopper - Fabrication - Topo Mesh to Laser Cutter.gh (Grasshopper 1.0.8)
# plug-ins: opennest_2 Info

# ----
# 00
# 01
# Topo
mesh = Mesh(<mesh referenced from the Rhino model>)

# ----
# Get the bounds of the mesh
# with a bounding box
# Add thickness to base
mesh_2 = Mesh(mesh)
bounding_box = BoundingBox(Content=mesh_2, Plane=PlaneXY(0, 0, 0))  # -> Box, Box_2
evaluate_box = EvaluateBox(Box=bounding_box.Box, UParameter=0.5, VParameter=0.5, WParameter="0")  # -> Plane, Point, Include
# Create Base (or sides) of surface for physical model
unit_z = UnitZ(Factor=Slider(5, range=0..100))
subtraction = Subtraction(A=evaluate_box.Point, B=unit_z)
point = Point(evaluate_box.Point)
# Contour Mesh
# Make curves less detailed
# Remove Lines that are too small
point_2 = Point(subtraction)

# ----
# 02
# Create Bottom of Mesh
mesh_3 = Mesh(mesh)
point_3 = Point(point_2)
project = Project(Geometry=mesh_3, Plane=point_3)  # -> Geometry, Transform
flip_mesh = FlipMesh(Mesh=project.Geometry, VertexNormals=True, FaceNormals=True, FaceOrientation=True)

# ----
# Create Sides of Mesh
point_4 = Point(point_2)
mesh_4 = Mesh(mesh)
mesh_edges = MeshEdges(Mesh=mesh_4)  # -> NakedEdges, InteriorEdges, NonManifoldEdges
project_2 = Project(Geometry=mesh_edges.NakedEdges, Plane=point_4)  # -> Geometry, Transform
end_points = EndPoints(Curve=mesh_edges.NakedEdges)  # -> Start, End
end_points_2 = EndPoints(Curve=project_2.Geometry)  # -> Start, End
merge = Merge(
    Data1=graft(end_points_2.End),
    Data2=graft(end_points_2.Start),
    Data3=graft(end_points.Start),
    Data4=graft(end_points.End))
construct_mesh = ConstructMesh(Vertices=merge, Faces={A=0, B=1, C=2, D=3})

# ----
# 03
# Join and Clean Mesh
merge_2 = Merge(Data2=flip_mesh, Data3=construct_mesh)  # -> flatten(Result)
mesh_join = MeshJoin(Meshes=merge_2)
weld_mesh = WeldMesh(Mesh=mesh_join, Angle=3.141592654)
unify_mesh = UnifyMesh(Mesh=weld_mesh)  # -> Result, Count
mesh_5 = Mesh(unify_mesh.Result)

# ----
# EX
polygon_center = PolygonCenter()  # -> CenterV, CenterE, CenterA; disabled
tree_statistics = TreeStatistics(Tree=polygon_center.CenterV)  # -> Paths, Length, Count; disabled
number_slider = Slider(14, range=0..100)  # disabled
series = Series(Start=0, Step=1, Count=tree_statistics.Count)  # disabled
text = Text(Location=polygon_center.CenterV, Text=graft(series), Size=number_slider)  # disabled

curve = Curve()  # disabled
project_3 = Project(Polyline=curve)  # -> Polyline, Plane; disabled
pack_objects = PackObjects(Geo=curve, Plane=project_3.Plane, X=1, Y=1, Tolerance=0)  # -> Geo, Transformation; disabled
boolean_toggle = BooleanToggle(True)  # disabled
boolean_toggle_2 = BooleanToggle(True)  # disabled
crv = Curve(<curve referenced from the Rhino model>)  # disabled
opennest1 = OpenNest1(
    Sheets=crv,
    Geo=pack_objects.Geo,
    Spacing=1,
    Placement=1,
    Tolerance=0.1,
    Rotations=4,
    Iterations=1,
    Seed=1,
    Reset=boolean_toggle_2,
    Run=boolean_toggle)  # -> Sheets, Geo, ID, Transform, IDS; disabled
transform = Transform(opennest1.Transform)  # disabled
tree_statistics_2 = TreeStatistics(Tree=transform)  # -> Paths, Length, Count; disabled
boundary_surfaces = BoundarySurfaces(Edges=opennest1.Geo)  # disabled
panel = Panel("0")  # disabled
curve_2 = Curve(opennest1.Geo)  # disabled
cull_index = CullIndex(List=tree_statistics_2.Paths, Indices=panel, Wrap=True)  # disabled
tree_branch = TreeBranch(Tree=transform, Path=cull_index, MaintainPaths=True)  # disabled

# ----
# 04
mesh_6 = Mesh(mesh)
point_5 = Point(point_2)

mesh_7 = Mesh(mesh_5)
point_6 = Point(point_2)

# ----
# Countour
# Simplify The Curves
number_slider_2 = Slider(5, range=0..10)

contour = Contour(Shape=mesh_6, Point=point_5, Direction=Vector(0, 0, 1), Distance=number_slider_2)

contour_2 = Contour(Shape=mesh_7, Point=point_6, Direction=Vector(0, 0, 1), Distance=number_slider_2)

curve_3 = Curve(contour)
curve_4 = Curve(contour_2)

# ----
# 05
# Remove Lines that are too small
curve_5 = Curve(curve_3)
length = Length(Curve=curve_5)
larger_than = LargerThan(FirstNumber=length, SecondNumber=Slider(80.1, range=0..100))  # -> LargerThan, OrEqualTo
cull_pattern = CullPattern(List=curve_5, CullPattern=larger_than.LargerThan)
curve_6 = Curve(cull_pattern)

# ----
# Reduce Detail of Curves
number_slider_3 = Slider(128, range=10..1000)
# 06
curve_7 = Curve(curve_6)
rebuild_curve = RebuildCurve(Curve=curve_7, Count=number_slider_3, Tangents=False)
# 07
curve_8 = Curve(rebuild_curve)

# ----
# Merge and Join
merge_3 = Merge(Data1=curve_8, Data2=curve_4)  # -> flatten(Result)
join_curves = JoinCurves(Curves=merge_3, Preserve=False)

simplify_curve = SimplifyCurve(Curve=join_curves)  # -> Curve, Simplified

# ----
# 08
# Check For Closed Curves
curve_9 = Curve(flatten(join_curves))
closed = Closed(Curve=curve_9)  # -> Closed, Periodic
cull_pattern_2 = CullPattern(List=curve_9, CullPattern=closed.Closed)
# 09
curve_10 = Curve(cull_pattern_2)

# ----
# Group Curves By Height
curve_11 = Curve(simplify_curve.Curve)
end_points_3 = EndPoints(Curve=curve_11)  # -> Start, End
deconstruct = Deconstruct(Point=end_points_3.Start)  # -> XComponent, YComponent, ZComponent
create_set = CreateSet(List=deconstruct.ZComponent)  # -> Set, Map
sort_list = SortList(Keys=create_set.Set)  # -> Keys, ValuesValuesA
member_index = MemberIndex(Set=deconstruct.ZComponent, Member=sort_list.Keys)  # -> Index, Count
list_item = ListItem(List=curve_11, Index=member_index.Index, Wrap=True)
curve_12 = Curve(list_item)

# ----
# 10
# Layout Cut Profiles
curve_13 = Curve(curve_12)
number_slider_4 = Slider(1200, range=0..10000)
tree_statistics_3 = TreeStatistics(Tree=curve_13)  # -> Paths, Length, Count
series_2 = Series(Start=number_slider_4, Step=number_slider_4, Count=tree_statistics_3.Count)
unit_x = UnitX(Factor=series_2)  # -> graft(UnitVector)
move = Move(Geometry=curve_13, Motion=unit_x)  # -> Geometry, Transform
xy_plane = XYPlane(Origin=Point(0, 0, 0))
project_4 = Project(Geometry=move.Geometry, Plane=xy_plane)  # -> Geometry, Transform
curve_14 = Curve(project_4.Geometry)

# ----
# Create Guides for Layout
# Group Curves Based on Height
# Layout
number_slider_5 = Slider(4, range=0..6)
deconstruct_brep = DeconstructBrep(Brep=bounding_box.Box)  # -> Faces, Edges, Vertices
list_item_2 = ListItem(List=deconstruct_brep.Faces, Index=number_slider_5, Wrap=True)
# Bake
number_slider_6 = Slider(1.3, range=0..10)
area = Area(Geometry=list_item_2)  # -> Area, Centroid
scale = Scale(Geometry=list_item_2, Center=area.Centroid, Factor=number_slider_6)  # -> Geometry, Transform
brep_edges = BrepEdges(Brep=scale.Geometry)  # -> Naked, Interior, NonManifold
move_2 = Move(Geometry=brep_edges.Naked, Motion=unit_x)  # -> Geometry, Transform

curve_15 = Curve(move_2.Geometry)
custom_preview = CustomPreview(Geometry=curve_15, Material=ColourSwatch(SwatchColor=RGB(117, 117, 117)))

# ----
# Simplify The Curves
number_slider_7 = Slider(2.94, range=0..10)
curve_16 = Curve(curve_14)
simplify_curve_2 = SimplifyCurve(Curve=curve_16, Tolerance=number_slider_7, AngleTolerance=Slider(0, range=0..10))  # -> Curve, Simplified
curve_17 = Curve(simplify_curve_2.Curve)

# ----
# 11
# Surface Display
boundary_surfaces_2 = BoundarySurfaces(Edges=curve_17)

curve_18 = Curve(curve_17)
custom_preview_2 = CustomPreview(Geometry=curve_18, Material=ColourSwatch(SwatchColor=RGB(0, 255, 255)))

# ----
# Create Allignment Curves
curve_19 = Curve(curve_17)
number = Number(number_slider_4)
tree_statistics_4 = TreeStatistics(Tree=curve_19)  # -> Paths, Length, Count
cull_index_2 = CullIndex(List=tree_statistics_4.Paths, Indices="0", Wrap=True)
negative = Negative(Value=number)
unit_x_2 = UnitX(Factor=negative)
tree_branch_2 = TreeBranch(Tree=curve_19, Path=cull_index_2, MaintainPaths=True)
move_3 = Move(Geometry=tree_branch_2, Motion=unit_x_2)  # -> Geometry, Transform
curve_20 = Curve(move_3.Geometry)

# ----
# 12
curve_21 = Curve(curve_20)
# 13
custom_preview_3 = CustomPreview(Geometry=curve_21, Material=ColourSwatch(SwatchColor=RGB(229, 255, 0)))

# ----
# Create Labels
polygon_center_2 = PolygonCenter(Polyline=curve_20)  # -> CenterV, CenterE, CenterA
tree_statistics_5 = TreeStatistics(Tree=polygon_center_2.CenterV)  # -> Paths, Length, Count
series_3 = Series(Start=0, Step=1, Count=tree_statistics_5.Count)
text_tag_3d = TextTag3D(Location=polygon_center_2.CenterV, Text=graft(series_3), Size=Slider(32, range=0..100), Justification=7)
