# Grasshopper definition Grasshopper - Kangaroo - Into.gh (Grasshopper 1.0.8)
# plug-ins: Bifocals

point = Point(Point(43.91274458, 112.3041718, 0))
# Caternary Shell
point_2 = Point(Point(194.0254562, 112.2191896, 0))
# 03
# Base Geometry
# The key for the input geometry is to provide Kangaroo with enough input so that it can calculate a proper result. For this example we are making a mesh that has an internal network that will be acted upon
point_3 = Point(Point(43.80341071, 302.9834695, 0))
# Caternary Curve
# 03
# Base Geometry
# The key for the input geometry is to provide Kangaroo with enough input so that it can calculate a proper result. For this example we are just making a line with multiple segments that the engine can act upon
line = Line(StartPoint=point, EndPoint=point_2)
xy_plane = XYPlane(Origin=point_3)
divide_curve = DivideCurve(Curve=line, Count=Slider(25, range=0..100), Kinks=False)  # -> Points, Tangents, Parameters
rectangle = Rectangle(Plane=xy_plane, XSize=Slider(150, range=0..500), YSize=Slider(150, range=0..500), Radius=0)  # -> Rectangle, Length
shatter = Shatter(Curve=line, Parameters=divide_curve.Parameters)
# This direction can be what ever you want, right now only the z direction has any value, but the computer is impartial to gravity or which way is up!
number_slider = Slider(9.18, range=-1..10)
# make this larger if you are experinceing performance issues
number_slider_2 = Slider(4, range=0..10)
mesh_plane = MeshPlane(Boundary=rectangle.Rectangle, WidthCount=Slider(30, range=0..100), HeightCount=Slider(30, range=0..100))  # -> Mesh, Area
vector_xyz = VectorXYZ(XComponent=Slider(0, range=-1..10), YComponent=Slider(0, range=-1..10), ZComponent=number_slider)  # -> Vector, Length
triremesh = TriRemesh(Geometry=mesh_plane.Mesh, Length=number_slider_2, Iterations=25)  # -> Triangulation, Dual, Creases

load = Load(Point=divide_curve.Points, ForceVector=vector_xyz.Vector, Weighting=1)
# 02
# 01
# Goals
# Main / Engine
# The goals are essentially the elements that you want Kangaroo to solve in order to create a balanced system and achieve equilibrium. In the class example we saw that without the anchor points the system moves indefinitely along the load vector.
# The main Kangaroo engine is essentially a built in loop that will attempt to balance the goals and provide a geometry that is in equilibrium or at rest.
length_line = LengthLine(Line=shatter, Strength=Slider(10, range=0..10))
anchor = Anchor(Point=[point, point_2], Strength=10000)

mesh_edges = MeshEdges(Mesh=triremesh.Triangulation)  # -> NakedEdges, InteriorEdges, NonManifoldEdges
nakedvertices = NakedVertices(Mesh=triremesh.Triangulation)  # -> ClothedIndex, NakedIndex, ClothedPts, NakedPts
meshcorners = MeshCorners(Mesh=triremesh.Triangulation, Angle=2.35619449)
unit_z = UnitZ(Factor=Slider(0.12, range=-1..10))

# ---- group: Click Me!
button = Button()

# ----
# 04
# Output
# The output geometry is provided by the kangaroo engine. If you would like to extract a different type of geometry from the system you can use the “show” node from the “main” tab in Kangaroo.
bouncysolver = BouncySolver(
    GoalObjects=[load, anchor, length_line],
    Reset=button,
    Threshold=1e-15,
    Tolerance=0.0001,
    Damping=0.99,
    Iterations=10,
    On=Toggle(True))  # -> I, V, O

load_2 = Load(Point=[nakedvertices.ClothedPts, nakedvertices.NakedPts], ForceVector=unit_z, Weighting=1)
length_line_2 = LengthLine(Line=[mesh_edges.NakedEdges, mesh_edges.InteriorEdges], Strength=10)
# 02
# Goals
show = Show(G=triremesh.Triangulation)
anchor_2 = Anchor(Point=meshcorners, Strength=10000)

line_2 = Line(bouncysolver.O)

# ---- group: Click Me!
button_2 = Button()

# ----
# 01
# 04
# Main / Engine
# Output
# The main Kangaroo engine is essentially a built in loop that will attempt to balance the goals and provide a geometry that is in equilibrium or at rest.
# The output geometry is provided by the kangaroo engine. If you would like to extract a different type of geometry from the system you can use the “show” node from the “main” tab in Kangaroo.
# Here we are using the list item to get only the mesh input from the show node
bouncysolver_2 = BouncySolver(
    GoalObjects=[load_2, anchor_2, length_line_2, show],
    Reset=button_2,
    Threshold=1e-15,
    Tolerance=0.0001,
    Damping=0.99,
    Iterations=10,
    On=Toggle(True))  # -> I, V, O

list_item = ListItem(List=bouncysolver_2.O, Index=0, Wrap=True)
mesh = Mesh(list_item)
