# Grasshopper definition Grasshopper Data Trees - Ito Column.gh (Grasshopper 1.0.7)
# plug-ins: Bifocals

# Toyo Ito Column
# Center Points of Circles
point = Point(Point(24.57643405, 22.73451032, 0.3891939766))
point_2 = Point(Point(25.23147828, 24.32599034, 32.08903143))
point_3 = Point(Point(25.23147828, 16.64432335, 18.71071306))
point_4 = Point(Point(25.23147828, 22.73451032, 50.02405763))
# Radius of Circles
number_slider = Slider(8, range=0..10)

point_5 = Point(Point(25.23147828, 22.73451032, 16.34617884))
point_6 = Point(Point(25.23147828, 22.73451032, 0))
circle_cnr = CircleCNR(Center=point_5, Normal=Vector(0, 0, 1), Radius=Slider(8, range=0..10))
circle_cnr_2 = CircleCNR(Center=point_6, Normal=Vector(0, 0, 1), Radius=Slider(10, range=0..10))
divide_curve = DivideCurve(Curve=circle_cnr_2, Count=Slider(12, range=0..12), Kinks=False)  # -> Points, Tangents, Parameters
divide_curve_2 = DivideCurve(Curve=circle_cnr, Count=Slider(12, range=0..12), Kinks=False)  # -> Points, Tangents, Parameters
line = Line(StartPoint=divide_curve_2.Points, EndPoint=divide_curve.Points)
shift_list = ShiftList(List=divide_curve_2.Points, Shift=Slider(1, range=0..10), Wrap=Toggle(True))
line_2 = Line(StartPoint=shift_list, EndPoint=divide_curve.Points)

merge = Merge(Data1=number_slider, Data2=Slider(5, range=0..100), Data3=Slider(6, range=0..100), Data4=Slider(10, range=0..100))
merge_2 = Merge(Data1=point, Data2=point_3, Data3=point_2, Data4=point_4)
circle_cnr_3 = CircleCNR(Center=merge_2, Normal=Vector(0, 0, 1), Radius=merge)
divide_curve_3 = DivideCurve(Curve=circle_cnr_3, Count=Slider(10, range=0..100), Kinks=False)  # -> simplify(Points), Tangents, Parameters

# ----
# Diagonal Struts
# Diagonal Strut Direction
# we graft the list of shift directions so that it matches the data structure of the points on the circles
# 
# Use a param viewer before and after, and compare it to the other data going into the shift list to see why
number_slider_2 = Slider(0, range=-1..1)
merge_3 = Merge(Data1=number_slider_2, Data2=Slider(1, range=-1..1), Data3=Slider(0, range=-1..1), Data4=Slider(1, range=-1..1))
graft_tree = GraftTree(Tree=merge_3, IncludeEmptyLists=True, IncludeNullItems=True)  # -> simplify(Tree)
shift_list_2 = ShiftList(List=divide_curve_3.Points, Shift=graft_tree, Wrap=True)
flip_matrix = FlipMatrix(Data=shift_list_2)
polyline = PolyLine(Vertices=flip_matrix, Closed=False)

flip_matrix_2 = FlipMatrix(Data=divide_curve_3.Points)
# Vertical Struts
polyline_2 = PolyLine(Vertices=flip_matrix_2, Closed=False)
