# Grasshopper definition MetaBallRoof-Exxample.gh (Grasshopper 1.0.7)

# ---- group: Radius
base_radius = Slider(11, range=0..25)

# ---- group: Contour curve
arc = CircularArc({Angle=0, Angle=1.465630204, Plane=PlaneXZ(-22.11111111, 0, 0), Radius=20.11111111})

# ----
# Parameters
height = Slider(29, range=0..100)
contours = Slider(29, range=0..50)
contour_multiplier = Slider(1, range=0..10)

# ---- group: Base Points
pt = Point([Point(16.57152701, 20.80879032, 0), Point(48.34078606, 102.530575, 0), Point(98.95044158, 122.8541587, 0), Point(157.52273, 27.32040087, 0)])

# ----
Z = UnitZ(Factor=height)
move = Move(Geometry=pt, Motion=Z)  # -> Geometry, Transform
ln = Line(StartPoint=pt, EndPoint=move.Geometry)
divide_curve = DivideCurve(Curve=ln, Count=contours, Kinks=False)  # -> Points, Tangents, Parameters
flip_matrix = FlipMatrix(Data=divide_curve.Points)

# ----
# Metaball 2D
number_slider = Slider(0.07, range=0..1)
construct_domain = ConstructDomain(DomainStart=Slider(0.01, range=-50..50), DomainEnd=number_slider)
multiplication = Multiplication(A=contours, B=contour_multiplier)
duplicate_data = DuplicateData(Data=pt, Number=contours, Order=True)
xy_plane = XYPlane(Origin=Point(0, 0, 0))
range = Range(Domain=construct_domain, Steps=multiplication)
metaball_t = MetaBallT(Points=flatten(duplicate_data), Plane=xy_plane, Threshold=range)

# ---- group: Rotation
refrence_rotation = Slider(0.9, range=0..2)

# ----
point = Point(flip_matrix)
list_item = ListItem(List=point, Index=0, Wrap=True)
unit_x = UnitX(Factor=base_radius)
point_2 = Point(list_item)
move_2 = Move(Geometry=point_2, Motion=unit_x)  # -> Geometry, Transform
list_item_2 = ListItem(List=flatten(point_2), Index=0, Wrap=True)  # -> Item1, Item
deconstruct = Deconstruct(Point=point_2)  # -> XComponent, YComponent, ZComponent
line = Line(StartPoint=list_item_2.Item1, EndPoint=list_item_2.Item)
bounds = Bounds(Numbers=flatten(deconstruct.ZComponent))
remap_numbers = RemapNumbers(Value=deconstruct.ZComponent, Source=bounds, Target=Domain(0, 1))  # -> Mapped, Clipped
pi = Pi(Factor=refrence_rotation)

# ---- group: Curve Profile
spread = Slider(31, range=0..100)
graph_mapper = GraphMapper(
    remap_numbers.Mapped,
    x0=0,
    x1=1,
    y0=0,
    y1=1,
    container_name="Bezier",
    cpx=[0, 0.7301234603, 0.9426544309, 1],
    cpy=[0, 0, 0.556555748, 1])

# ----
multiplication_2 = Multiplication(A=graph_mapper, B=spread)
unit_x_2 = UnitX(Factor=multiplication_2)
move_3 = Move(Geometry=move_2.Geometry, Motion=unit_x_2)  # -> Geometry, Transform
rotate_axis = RotateAxis(Geometry=move_3.Geometry, Angle=pi, Axis=line)  # -> Geometry, Transform
polyline = PolyLine(Vertices=flatten(rotate_axis.Geometry), Closed=False)

# ---- group: Dynamic Countour
curve = Curve(polyline)

# ----
list_item_3 = ListItem(List=flip_matrix, Index=0, Wrap=True)
xy = XYPlane(Origin=list_item_3)
pcx = CurvePlane(Curve=flatten(curve), Plane=xy)  # -> Points, ParamsC, ParamsP

# ----
# Metaball 3D
metaball = MetaBall(Points=flip_matrix, Plane=xy, Point=pcx.Points)

# ----
# Custom Preview from Z value
end_points = EndPoints(Curve=metaball)  # -> Start, End
construct_domain_2 = ConstructDomain(DomainStart="1", DomainEnd=contours)
deconstruct_2 = Deconstruct(Point=end_points.Start)  # -> XComponent, YComponent, ZComponent
gradient = Gradient(
    LowerLimit=0,
    UpperLimit=construct_domain_2,
    Parameter=deconstruct_2.ZComponent,
    stops=[0: RGB(255, 255, 255), 1: RGB(0, 0, 0)])
gradient_2 = Gradient(
    LowerLimit=0,
    UpperLimit=construct_domain_2,
    Parameter=deconstruct_2.ZComponent,
    stops=[0: RGB(255, 0, 0), 0.477: RGB(255, 247, 0), 1: RGB(42, 0, 255)])

# ----
# Custom Preview For 2D curves
list_length = ListLength(List=flatten(metaball_t))
series = Series(Start=1, Step=1, Count=list_length)
gradient_3 = Gradient(LowerLimit=0, UpperLimit=construct_domain_2, Parameter=series, stops=[0: RGB(0, 0, 0), 1: RGB(255, 255, 255)])
gradient_4 = Gradient(
    LowerLimit=0,
    UpperLimit=construct_domain_2,
    Parameter=series,
    stops=[0: RGB(42, 0, 255), 0.242: RGB(255, 247, 0), 1: RGB(255, 0, 0)])

preview = CustomPreview(Geometry=metaball, Shader=reverse(gradient))
preview_2 = CustomPreview(Geometry=metaball_t, Shader=graft(gradient_4))
