# Grasshopper definition MetaBallRoof-simple.gh (Grasshopper 1.0.7)

number_slider = Slider(20, range=0..20)
pt = Point([Point(16.3217256, 3.449679914, 0), Point(86.56218853, -3.277185519, 0), Point(55.55462444, 27.96370194, 0)])
arc = CircularArc({Angle=0, Angle=1.465630204, Plane=PlaneXZ(-22.11111111, 0, 0), Radius=20.11111111})
Z = UnitZ(Factor=Slider(21, range=0..100))
move = Move(Geometry=pt, Motion=Z)  # -> Geometry, Transform
# Metaball 2D_Round
duplicate_data = DuplicateData(Data=pt, Number=number_slider, Order=True)
range = Range(Domain=Domain(0, 1), Steps=number_slider)
ln = Line(StartPoint=pt, EndPoint=move.Geometry)
range_2 = Range(Domain=Domain(0, 20), Steps=number_slider)
xy = XYPlane(Origin=Point(0, 0, 0))
metaball_t = MetaBallT(Points=flatten(duplicate_data), Plane=PlaneXY(0, 0, 0), Threshold=range)

# ----
# Custom Preview
series = Series(Start=1, Step=1, Count=number_slider)
bnd = Bounds(Numbers=series)
gradient = Gradient(LowerLimit=0, UpperLimit=bnd, Parameter=series, stops=[0: RGB(42, 0, 255), 0.324: RGB(255, 247, 0), 1: RGB(255, 0, 0)])
preview = CustomPreview(Geometry=metaball_t, Shader=graft(gradient))

crv = Curve(ln)
pl_offset = PlaneOffset(BasePlane=xy, Offset=range_2)
pcx = CurvePlane(Curve=arc, Plane=pl_offset)  # -> Points, ParamsC, ParamsP
pcx_2 = CurvePlane(Curve=crv, Plane=graft(pl_offset))  # -> Points, ParamsC, ParamsP
path_mapper = PathMapper(pcx_2.Points, source="{A;B;C;D}", target="{A;B;C}")
metaball = MetaBall(Points=path_mapper, Plane=graft(pl_offset), Point=pcx.Points)
