# Grasshopper definition Philotaxis.gh (Grasshopper 1.0.7)
# plug-ins: Bifocals, Rhino.Inside for Autodesk Revit

height = Slider(192, range=0..1000)
# Rhino-Inside Revit : Example
radius_factor = Slider(178, range=0..1000)
series = Series(Start=0, Step=1, Count=radius_factor)

# ----
# Philotaxis 3d
expression = Expression(t=series, Expression="cos(t)*t")
expression_2 = Expression(t=series, Expression="sin(t)*t")

# ----
# Z-Axis from graph mapper
dom = ConstructDomain(DomainStart=0, DomainEnd=1)
bnd = Bounds(Numbers=series)
number = Number(height)
remap = RemapNumbers(Value=series, Source=bnd, Target=dom)  # -> Mapped, Clipped
graph_mapper = GraphMapper(remap.Mapped, x0=0, x1=1, y0=0, y1=1, container_name="Bezier", cpx=[0, 0, 0.6063552499, 1], cpy=[0, 1, 1, 1])
multiplication = Multiplication(A=graph_mapper, B=number)

# ----
# Create Geometry
construct_point = ConstructPoint(XCoordinate=expression, YCoordinate=expression_2, ZCoordinate=multiplication)
delaunay_mesh = DelaunayMesh(Points=flatten(construct_point), Plane=PlaneXY(0, 0, 0))

# ----
# Extract Values for Adaptive Component
mesh = Mesh(delaunay_mesh)
face_boundaries = FaceBoundaries(Mesh=mesh)
control_points = ControlPoints(Curve=face_boundaries)  # -> Points, Weights, Knots

# ----
# Extract Values for Beams
mesh_2 = Mesh(delaunay_mesh)
mesh_edges = MeshEdges(Mesh=mesh_2)  # -> NakedEdges, InteriorEdges, NonManifoldEdges

cull_index = CullIndex(List=control_points.Points, Indices="-1", Wrap=True)

# ----
# Create Revit Adapive Component
point = Point(cull_index)
type = Type(<familysymbol referenced from the Revit model>)
panel = Panel(type)
add_component_adaptive = AddComponentAdaptive(Points=point, Type=type, TrackingMode=2)

# ----
# Create Revit Beams
level = Level(<level referenced from the Revit model>)
line = Line(mesh_edges.InteriorEdges)
type_2 = Type(
    <familysymbol referenced from the Revit model>,
    SelectedBuiltInCategory="autodesk.revit.category.family:structuralFraming")
panel_2 = Panel(level)
panel_3 = Panel(type_2)
add_structural_beam = AddStructuralBeam(Curve=line, Type=type_2, ReferenceLevel=level, TrackingMode=2)
