# Grasshopper definition ImgPerf-v2.gh (Grasshopper 1.0.8)
# plug-ins: Rhino.Inside for Autodesk Revit, Bifocals, LunchBox

# PERFORATED PANNEL WALL
# Christopher Schwalbe - 2025 10 11 from 2017 version
# Addins Used
# Notes
# Use an image that cover the wall.
# Adjust the image sampler domins in the positve and negative to stretch and position the image on the wall.
panel = Panel("")

# ----
# 01
# Get Geometry from Revit Wall
wall = Wall(<wall referenced from the Revit model>)
element_geometry = ElementGeometry(Elements=wall)
deconstruct_brep = DeconstructBrep(Brep=element_geometry)  # -> Faces, Edges, Vertices
md_slider = MDSlider(SliderMode=0, slider_value=Point(0, 0, 0.5), x_domain=Domain(0, 1), y_domain=Domain(0, 1), z_domain=Domain(0, 1))
list_item = ListItem(List=deconstruct_brep.Faces, Index=Slider(0, range=0..6), Wrap=True)
evaluate_surface = EvaluateSurface(Surface=reparameterize(list_item), Point=md_slider)  # -> Point, Normal, UDirection, VDirection, Frame
surface = Surface(list_item)
plane = Plane(evaluate_surface.Frame)

# ----
# Pannel Layout
# size of each pannel
# number of pannels
extent_x = Slider(24, range=0..100)
extent_y = Slider(3, range=0..1000)
size_y = Slider(96, range=0..100)
size_x = Slider(48, range=0..100)

# ----
# Grid Size
# number of grid cells
number_slider = Slider(4, range=0..10000)

# ----
# Inches to Feet
expression = Expression(x=size_x, Expression="x/12")
expression_2 = Expression(x=size_y, Expression="x/12")

# ----
# 02
# Create Panels
plane_2 = Plane(evaluate_surface.Frame)
recgrid = Rectangular(Plane=plane_2, SizeX=expression, SizeY=expression_2, ExtentX=extent_x, ExtentY=extent_y)  # -> Cells, Points

# ----
# Inches to Feet
expression_3 = Expression(x=number_slider, Expression="x/12")
expression_4 = Expression(x=Slider(4, range=0..1000), Expression="x/12")

# ----
# Create Points for Circle Locations
surface_2 = Surface(surface)
deconstruct_brep_2 = DeconstructBrep(Brep=surface_2)  # -> Faces, Edges, Vertices
list_item_2 = ListItem(List=deconstruct_brep_2.Edges, Index=0, Wrap=True)  # -> Item, Item1
length = Length(Curve=list_item_2.Item)
length_2 = Length(Curve=list_item_2.Item1)
division = Division(A=length_2, B=expression_4)
division_2 = Division(A=length, B=expression_3)
divide_domain² = DivideDomain²(Domain=deconstruct_brep_2.Faces, UCount=division_2, VCount=division)
isotrim = Isotrim(Surface=deconstruct_brep_2.Faces, Domain=divide_domain²)
brep_edges = BrepEdges(Brep=isotrim)  # -> Naked, Interior, NonManifold
polygon_center = PolygonCenter(Polyline=isotrim)  # -> CenterV, CenterE, CenterA

# ----
# Check that Points are in a Panel
surface_closest_point = SurfaceClosestPoint(Point=polygon_center.CenterV, Surface=deconstruct_brep_2.Faces)  # -> Point, UVPoint, Distance
incurves = PointInCurves(Point=flatten(polygon_center.CenterV), Curves=flatten(recgrid.Cells))  # -> Relationship, Index, Point
equals = Equality(FirstNumber=incurves.Relationship, SecondNumber="2")  # -> Equality, Inequality
cull = CullPattern(List=flatten(surface_closest_point.UVPoint), CullPattern=equals.Equality)
cull_2 = CullPattern(List=flatten(polygon_center.CenterV), CullPattern=equals.Equality)

# ----
# Create the points that will be used for the image sample and the corresponding pannel grid in order to avoid having any perforations on the seam of the pannels.
# This also allows greater control over the density of the perforations and how many perforations will be in each pannel
boundary = BoundarySurfaces(Edges=flatten(recgrid.Cells))

# ---- group: Panel Surfaces
surface_3 = Surface(boundary)

# ---- group: UV Points
point = Point(cull)

# ---- group: XY Points
point_2 = Point(cull_2)

# ----
# Input Image
# set dpi of image to match real wold scale
# EX: surface = 50cm x 100cm, image = 50px x 100px
image = ImageSampler(point, Filter="Colour", Interpolate=True, Umax=112, Umin=0, Vmax=29, Vmin=0, Wrap=0)
bnd = Bounds(Numbers=image)

# ----
# Rationalize
# get the sample values and set a series of domians
# that will be used to rationalize the floating numbers
# output from the image sampler
# output domain from Image Sample
# Break points for new domains
# New domains
toggle = BooleanToggle(False)
panel_2 = Panel(bnd)
consec = ConsecutiveDomains(
    Numbers=[Slider(0, range=0..4), Slider(0.5, range=0..4), Slider(0.75, range=0..4), Slider(1, range=0..4), Slider(1.5, range=0..4), Slider(1.8, range=0..4)],
    Additive=toggle)
panel_3 = Panel(consec)

# ----
# Hole Radius
# the new hole sizes to be mapped
# to the new domains
number_slider_2 = Slider(0.5, range=0..4)

# ----
# Inches to Feet
expression_5 = Expression(Radius=number_slider_2, Expression="Radius/12")
expression_6 = Expression(Radius=Slider(0.75, range=0..4), Expression="Radius/12")
expression_7 = Expression(Radius=Slider(1, range=0..4), Expression="Radius/12")
expression_8 = Expression(Radius=Slider(1.5, range=0..4), Expression="Radius/12")
expression_9 = Expression(Radius=Slider(1.75, range=0..4), Expression="Radius/12")

# ----
# 03
# Sample the image to use as a driver for the perforation geometry (in this case the radius of the perforation circle).
# The sample values are then rationalized into the defined values to minimize the ammount of variation in the perforations.
pt = Point(point_2)
fdom = FindDomain(Domains=consec, Number=image, Strict=False)  # -> Index, Neighbour
equals_2 = Equality(FirstNumber=fdom.Index, SecondNumber="0")  # -> Equality, Inequality
equals_3 = Equality(FirstNumber=fdom.Index, SecondNumber="1")  # -> Equality, Inequality
equals_4 = Equality(FirstNumber=fdom.Index, SecondNumber="2")  # -> Equality, Inequality
equals_5 = Equality(FirstNumber=fdom.Index, SecondNumber="3")  # -> Equality, Inequality
equals_6 = Equality(FirstNumber=fdom.Index, SecondNumber="4")  # -> Equality, Inequality
Y = UnitY(Factor=1)
Y_2 = UnitY(Factor=1)
cull_3 = CullPattern(List=pt, CullPattern=equals_2.Equality)
cull_4 = CullPattern(List=pt, CullPattern=equals_3.Equality)
cull_5 = CullPattern(List=pt, CullPattern=equals_4.Equality)
cull_6 = CullPattern(List=pt, CullPattern=equals_5.Equality)
cull_7 = CullPattern(List=pt, CullPattern=equals_6.Equality)
Y_3 = UnitY(Factor=1)
Y_4 = UnitY(Factor=1)
Y_5 = UnitY(Factor=1)
circle = CircleCNR(Center=cull_3, Normal=Y_2, Radius=expression_5)
circle_2 = CircleCNR(Center=cull_4, Normal=Y, Radius=expression_6)
circle_3 = CircleCNR(Center=cull_5, Normal=Y_3, Radius=expression_7)
circle_4 = CircleCNR(Center=cull_6, Normal=Y_4, Radius=expression_8)
circle_5 = CircleCNR(Center=cull_7, Normal=Y_5, Radius=expression_9)
circle_6 = Circle([circle, circle_2, circle_3, circle_4, circle_5])

# ----
# Get the profile of the wall and use it to trim the pannels
# so that the panles match the wall exactly.
# The split node will appear Orange if not all panels are cut
# Trim the pannels to the size of the wall
# since we have a wall that does not match
# the module of our panel size
crv_fromhummingbirdrvt = Curve(deconstruct_brep_2.Edges)
# 04
brep = Brep(surface_3)
join_curves = JoinCurves(Curves=crv_fromhummingbirdrvt, Preserve=False)
split = SplitBrep(Brep=brep, Cutter=graft(join_curves))
item = ListItem(List=split, Index=0, Wrap=True)
flatten = FlattenTree(Tree=item, Path="{0}")

# ----
# data dam to improve
# performance
dam = DataDam(DataA=circle_6, BufferDelay=10000000, BufferMode=0)

# ----
# data dam to improve
# performance
dam_2 = DataDam(DataA=flatten, BufferDelay=10000000, BufferMode=0)

# ----
# 05
# increment bake with a counter
# Activate the timer and set the Reset boolean to False
timer = Timer(Interval=10, TimerInterval=10, Target=c_script)  # disabled
c_script = CSharpScript(reset=Toggle(False))  # -> out, a; inputs reset: Boolean
# ---------- c_script: C# ----------
// Grasshopper Script Instance
#region Usings
using System;
using System.Linq;
using System.Collections;
using System.Collections.Generic;
using System.Drawing;

using Rhino;
using Rhino.Geometry;

using Grasshopper;
using Grasshopper.Kernel;
using Grasshopper.Kernel.Data;
using Grasshopper.Kernel.Types;
#endregion

public class Script_Instance : GH_ScriptInstance
{
    #region Notes
    /* 
      Members:
        RhinoDoc RhinoDocument
        GH_Document GrasshopperDocument
        IGH_Component Component
        int Iteration

      Methods (Virtual & overridable):
        Print(string text)
        Print(string format, params object[] args)
        Reflect(object obj)
        Reflect(object obj, string method_name)
    */
    #endregion

    private void RunScript(bool reset, ref object a)
    {
        // Write your logic here
        if(reset)i = 0; else i++;
        a = i;
    }

    int i;
}
# ---------- end c_script ----------
panel_4 = Panel(c_script.a)

# ----
# Due to performnace issues each pannels is baked into rhino incrementally.
# This allows for visual feedback that everything is working, and also reduces the loss of work in the case of an accidental crash or run-change
circle_7 = Circle(dam)
surface_4 = Surface(dam_2)
item_2 = ListItem(List=surface_4, Index=c_script.a, Wrap=False)

# ----
# find which circles are within the pannel
# at the counted index
circle_8 = Circle(circle_7)
pt_2 = Point(circle_8)
incurve = PointInCurve(Point=pt_2, Curve=item_2)  # -> Relationship, Point
larger = LargerThan(FirstNumber=incurve.Relationship, SecondNumber="1")  # -> LargerThan, OrEqualTo
cull_8 = CullPattern(List=circle_8, CullPattern=larger.OrEqualTo)

# ----
# cut the circles out of the surface
srfsplit = SurfaceSplit(Surface=item_2, Curves=flatten(cull_8))
area = Area(Geometry=srfsplit)  # -> Area, Centroid
sort = SortList(Keys=area.Area, ValuesA=srfsplit)  # -> Keys, ValuesA
item_3 = ListItem(List=reverse(sort.ValuesA), Index=0, Wrap=True)

# ----
# use the counter to incrementally
# bake the panels into rhino
lng = ListLength(List=surface_4)
smaller = SmallerThan(FirstNumber=c_script.a, SecondNumber=lng)  # -> SmallerThan, OrEqualTo
bake = ObjectBake(
    BakeToggle=smaller.SmallerThan,
    GeometryObjects=item_3,
    Layer="GH_Bake",
    ObjectName="GH_Obj",
    ObjectColor=RGB(255, 255, 255),
    LayerColor=RGB(255, 255, 255))

# ----
# 06
# Gather Layer Data and Create Revit Elements
geometry_pipeline = GeometryPipeline(
    GroupByLayer=False,
    GroupByType=False,
    IncludeHidden=True,
    IncludeLocked=True,
    LayerFilter="GH_Bake",
    NameFilter="*",
    SublayerFiltering=True,
    TypeFilter=1073741848)
md_slider_2 = MDSlider(SliderMode=0, slider_value=Point(0.5, 0.5, 0.5), x_domain=Domain(0, 1), y_domain=Domain(0, 1), z_domain=Domain(0, 1))
data_dam = DataDam(DataDataA=geometry_pipeline, BufferDelay=10000000, BufferMode=0)
evaluate_surface_2 = EvaluateSurface(Surface=data_dam, Point=md_slider_2)  # -> Point, Normal, UDirection, VDirection, Frame
expression_10 = Expression(Radius=Slider(0.3, range=0..1), Expression="Radius/12")
amplitude = Amplitude(Vector=evaluate_surface_2.Normal, Amplitude=expression_10)
move = Move(Geometry=data_dam, Motion=amplitude)  # -> Geometry, Transform
data_dam_2 = DataDam(DataDataA=move.Geometry, BufferDelay=10000000, BufferMode=0)
add_directshape_brep = AddDirectShapeBrep(Brep=data_dam_2, TrackingMode=2)
